# Grasshopper definition Colibri_2-Advanced.gh (Grasshopper 1.0.7)
# plug-ins: CORE.Grasshopper.Colibri

# ---- group: Option C: Combo
# In this case:
# Evenly take 3 values from "X" parameter;
# Evenly take 3 values from "Y" parameter;
# Evenly take 3 values from "Z" parameter;
# 
# Now we have 3x3x3 = 27 Iterations in total;
# Then run from #3 to #6 iteration from above 27
panel = Panel("""3
3
3""")
dom = ConstructDomain(DomainStart="3", DomainEnd="6")
panel_2 = Panel(dom)
sub_domain = ColibriIterationSubdomain(Divisions=panel, Domain=dom)

# ---- group: Option A: Division
# Advanced Output with Colibri
# COLIBRI 2
# Thornton Tomasetti | CORE studio
# Visualize your Data with
# https://thread.thorntontomasetti.com/
# https://tt-acm.github.io/DesignExplorer/
# Colibri 1 (Legacy)
# https://www.food4rhino.com/en/app/tt-toolbox
# https://github.com/tt-acm/Colibri.Grasshopper
# In this case:
# Evenly take 6 values from "X" parameter;
# Evenly take 3 values from "Y" parameter;
# Take 1 value from "Z" parameter;
panel_3 = Panel("""6
3
1""")
sub_domain_2 = ColibriIterationSubdomain(Divisions=panel_3)

# ---- group: Option B: Domain
# In this case:
# Run from #9 to #18 iteration
panel_4 = Panel("9")
dom_2 = ConstructDomain(DomainStart=panel_4, DomainEnd="18")
panel_5 = Panel(dom_2)
sub_domain_3 = ColibriIterationSubdomain(Domain=dom_2)

# ----
data = Data(sub_domain_2)

# ---- group: 2: Run Inputs by clicking "Fly" / Alternatively Toggle the "R" Input to true
toggle = BooleanToggle(False)

# ---- group: 2: Run Inputs by clicking "Fly"
X = Slider(1, range=1..5)
Y = ValueList({"1", "2", "3", "4", "5"}, selected="1")
Z = Panel("""1
3
5""")
# © 2022 CORE studio | Thornton Tomasetti
# https://www.thorntontomasetti.com/core-studio
# https://coresso.thorntontomasetti.com/eula
colibri_in = ColibriInputsIterator(R=toggle, S=data, X=X, Y=Y, Z=Z, ignoreAllWarningMsg=True)  # -> U, IP, X, Y, Z, V_N

# ---- group: Test Geometry
box = CenterBox(Base=PlaneXY(0, 0, 0), X=colibri_in.X, Y=colibri_in.Y, Z=colibri_in.Z)
volume = Volume(Geometry=box)  # -> Volume, Centroid
area = Area(Geometry=box)  # -> Area, Centroid
wires = BrepWireframe(Brep=box, Density=-1)
len = Length(Curve=wires)
ma = MassAddition(Input=len)  # -> Result, PartialResults
volume_m3 = Number(volume.Volume)
total_length_m = Number(ma.Result)
area_m2 = Number(area.Area)

# ---- group: Image Settings
panel_6 = Panel("""Perspective
Top""")
set_img = ColibriImageSetting(ImageSaveAsName=colibri_in.U, RhinoViewNames=panel_6, Width="600", Height="600")

# ---- group: Collect Outputs
colibri_out = ColibriOutputs(Volume_m3=flatten(volume_m3), Area_m2=flatten(area_m2), Total_Length_m=flatten(total_length_m))

# ---- group: 1: Switch "Toggle" to true to record results
toggle_2 = BooleanToggle(False)
panel_7 = Panel("C:\Colibri")

# Right Click on this component to see additional options for writing data
ca = ColibriAggregator(Folder=panel_7, Inputs=colibri_in.IP, Outputs=colibri_out, ImageSetting=set_img, Write=toggle_2, recordingMode=0)
