# Grasshopper definition Colibri_2-Basic.gh (Grasshopper 1.0.7)
# plug-ins: CORE.Grasshopper.Colibri

# ---- group: 2: Run Inputs by clicking "Fly"
# Getting Started with Colibri
# COLIBRI 2
# Thornton Tomasetti | CORE studio
# Visualize your Data with
# https://thread.thorntontomasetti.com/
# https://tt-acm.github.io/DesignExplorer/
# Colibri 1 (Legacy)
# https://www.food4rhino.com/en/app/tt-toolbox
# https://github.com/tt-acm/Colibri.Grasshopper
X = Slider(1, range=1..3)
Y = ValueList({"1", "2", "3"}, selected="3")
Z = Panel("""1
3
5""")
colibri_in = ColibriInputsIterator(X=X, Y=Y, Z=Z, ignoreAllWarningMsg=True)  # -> U, IP, X, Y, Z, V_N

# ---- group: Test Geometry
box = CenterBox(Base=PlaneXY(0, 0, 0), X=colibri_in.X, Y=colibri_in.Y, Z=colibri_in.Z)
volume = Volume(Geometry=box)  # -> Volume, Centroid
area = Area(Geometry=box)  # -> Area, Centroid
wires = BrepWireframe(Brep=box, Density=-1)
len = Length(Curve=wires)
ma = MassAddition(Input=len)  # -> Result, PartialResults
# © 2022 CORE studio | Thornton Tomasetti
# https://www.thorntontomasetti.com/core-studio
# https://coresso.thorntontomasetti.com/eula
volume_m3 = Number(volume.Volume)
area_m2 = Number(area.Area)
total_length_m = Number(ma.Result)

# ---- group: Collect Outputs
colibri_out = ColibriOutputs(Volume_m3=flatten(volume_m3), Area_m2=flatten(area_m2), Total_Length_m=flatten(total_length_m))

# ---- group: 1: Switch "Toggle" to true to record results
ca = ColibriAggregator(Folder="C:\Colibri", Inputs=colibri_in.IP, Outputs=colibri_out, Write=Toggle(False), recordingMode=0)
