# Grasshopper definition Colibri_2-Galapagos.gh (Grasshopper 1.0.7)
# plug-ins: CORE.Grasshopper.Colibri

# ---- group: Test Solution
# Colibri + Galapagos
# COLIBRI 2
# Thornton Tomasetti | CORE studio
# Visualize your Data with
# https://thread.thorntontomasetti.com/
# https://tt-acm.github.io/DesignExplorer/
# Colibri 1 (Legacy)
# https://www.food4rhino.com/en/app/tt-toolbox
# https://github.com/tt-acm/Colibri.Grasshopper
pt = Point([Point(-49.94976008, 0, -126.0947265), Point(-93.82921712, 0, -50.53088579), Point(-19.38183205, 0, -90.11037929)])
crv = Curve(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)
chain_length = Slider(286.13, range=10..1000)
end = EndPoints(Curve=crv)  # -> Start, End
cat = Catenary(PointA=end.Start, PointB=end.End, Length=chain_length, Gravity=Vector(0, 0, -1))
crv_cp = CurveClosestPoint(Point=pt, Curve=cat)  # -> Point, Parameter, Distance
ma = MassAddition(Input=crv_cp.Distance)  # -> Result, PartialResults
cumulative_distance = Number(ma.Result)

# ---- group: 2: Galapagos
# © 2022 CORE studio | Thornton Tomasetti
# https://www.thorntontomasetti.com/core-studio
# https://coresso.thorntontomasetti.com/eula
galapagos = Galapagos(fitness=ma, gene=chain_length)

# ---- group: Colibri Recording / 1: Switch to True
toggle = BooleanToggle(False)

# ---- group: Colibri Recording
colibri_out = ColibriOutputs(Chain_Length=flatten(chain_length))
colibri_out_2 = ColibriOutputs(Cumulative_Distance=flatten(cumulative_distance))
ca = ColibriAggregator(Folder="C:\Colibri", Inputs=colibri_out, Outputs=colibri_out_2, Write=toggle, recordingMode=0)
