# Grasshopper definition gh_script_to_trigger_LunchBox_installation.gh (Grasshopper 1.0.7)
# plug-ins: LunchBox, Karamba3D

number_slider = Slider(1.1, range=0..10)
number = Number(Slider(0, range=0..10))
construct_point = ConstructPoint(XCoordinate=0, YCoordinate=0, ZCoordinate=0)
number_2 = Number(Slider(0, range=0..10))
construct_domain = ConstructDomain(DomainStart=number, DomainEnd=1)
construct_domain_2 = ConstructDomain(DomainStart=number_2, DomainEnd=1)
point = Point(construct_point)
rectangle = Rectangle(Plane=point, XSize=construct_domain, YSize=construct_domain_2, Radius=0)  # -> Rectangle, Length
boundary_surfaces = BoundarySurfaces(Edges=rectangle.Rectangle)
unit_z = UnitZ(Factor=number_slider)
surface = Surface(boundary_surfaces)
move = Move(Geometry=surface, Motion=unit_z)  # -> Geometry, Transform
surface_2 = Surface(move.Geometry)
integer = Integer(Slider(2, range=0..10))
grid_structure = GridStructure(Surface=surface_2, UDivisions=integer, VDivisions=integer)  # -> StructureLines, StructureNodes
merge = Merge(
    Data1=Slider(0, range=-1..10),
    Data2=Slider(0, range=-1..10),
    Data3=Slider(0, range=-1..10),
    Data4=Slider(0, range=-1..10),
    Data5=Slider(0, range=-1..10),
    Data6=Slider(0, range=-1..10),
    Data7=Slider(0, range=-1..10),
    Data8=Slider(0, range=-1..10),
    Data9=Slider(0, range=-1..10))
number_3 = Number(merge)
merge_2 = Merge(
    Data1=Slider(0, range=-1..10),
    Data2=Slider(0, range=-1..10),
    Data3=Slider(0, range=-1..10),
    Data4=Slider(0, range=-1..10),
    Data5=Slider(2, range=-1..10),
    Data6=Slider(0, range=-1..10),
    Data7=Slider(0, range=-1..10),
    Data8=Slider(0, range=-1..10),
    Data9=Slider(0, range=-1..10))
number_4 = Number(Slider(0.29, range=0..1))
multiplication = Multiplication(A=number_3, B=number_4)
number_5 = Number(Slider(0.254, range=0..1))
number_6 = Number(merge_2)
number_7 = Number(Slider(0.32, range=0..1))
number_8 = Number(multiplication)
multiplication_2 = Multiplication(A=number_6, B=number_7)
addition = Addition(A=number_8, B=number_5)
number_9 = Number(multiplication_2)
unit_z_2 = UnitZ(Factor=number_9)
addition_2 = Addition(A=multiplication_2, B=addition)
point_2 = Point(grid_structure.StructureNodes)
unit_z_3 = UnitZ(Factor=addition_2)
vector = Vector(unit_z_2)
integer_2 = Integer(expr("x+1", number_slider))
move_2 = Move(Geometry=point_2, Motion=vector)  # -> Geometry, Transform
vector_2 = Vector(unit_z_3)
point_3 = Point(move_2.Geometry)
point_4 = Point(point_2)
surface_from_points = SurfaceFromPoints(Points=point_3, UCount=expr("x+1", integer_2), Interpolate=True)
move_3 = Move(Geometry=point_4, Motion=vector_2)  # -> Geometry, Transform
point_5 = Point(move_3.Geometry)
surface_from_points_2 = SurfaceFromPoints(Points=point_5, UCount=expr("x+1", integer_2), Interpolate=True)
surface_3 = Surface(surface_from_points)
integer_3 = Integer(Slider(6, range=0..50))
surface_4 = Surface(surface_from_points_2)
integer_4 = Integer(integer_3)
space_truss_structure_2 = SpaceTrussStructure2(SurfaceA=surface_3, SurfaceB=surface_4, UDivisions=integer_4, VDivisions=integer_4)  # -> PrimaryLines, PrimaryLines_2, WebLines, StructureNodes
curve = Curve(space_truss_structure_2.WebLines)
curve_2 = Curve(space_truss_structure_2.PrimaryLines)
curve_3 = Curve(space_truss_structure_2.PrimaryLines_2)
point_6 = Point(space_truss_structure_2.StructureNodes)
end_points = EndPoints(Curve=curve_2)  # -> Start, End
list_item = ListItem(List=point_6, Index=Slider(40, range=0..50), Wrap=True)
count = Count(Slider(4, range=0..10))
pipe = Pipe(Curve=curve_3, Radius=Slider(0.005, range=0..1), Caps=0)
point_7 = Point(end_points.End)
point_8 = Point(end_points.Start)
point_9 = Point([<point referenced from the Rhino model> x4])
point_10 = Point(point_9)
merge_3 = Merge(Data1=point_8, Data2=point_7)
point_11 = Point(merge_3)
create_set = CreateSet(List=point_11)  # -> Set, Map
unit_z_4 = UnitZ(Factor=1)
point_12 = Point(create_set.Set)
point_13 = Point(point_12)
closest_points = ClosestPoints(Point=point_10, Cloud=point_13, Count=count)  # -> simplify(ClosestPoint), CPIndex, Distance
point_14 = Point(closest_points.ClosestPoint)
line = Line(StartPoint=point_14, EndPoint=graft(point_9))
panel = Panel(point_14)
curve_4 = Curve(flatten(line))
merge_4 = Merge(Data1=curve_2, Data2=curve_3, Data3=curve, Data4=curve_4)
negative = Negative(Value=unit_z_4)
curve_5 = Curve(flatten(merge_4))
pos_ind = PosInd(point_6)
support_karamba3d = SupportKaramba3D(PosInd=point_9, menu=[buttons(on, on, on, off, off, off)])
loads_karamba3d = LoadsKaramba3D(ForceVector=negative, Local=False, PosInd=pos_ind, LCase="0", mode="Point")
line_to_beam_karamba3d = LineToBeamKaramba3D(
    Line=curve_5,
    New=True,
    Remove=True,
    LimitDistance_m=0.005,
    Bending=True,
    SetBucklingLength=True,
    ToPolylineMaxAngle=0.03,
    ToPolylineTolerance=0.01,
    ToPolylineMaxEdgeLength=0.25)  # -> Element, Points, Info
assemble_model_karamba3d = AssembleModelKaramba3D(Elem=line_to_beam_karamba3d.Element, Support=support_karamba3d, Load=loads_karamba3d, LimitDistance_m=0.005)  # -> Model, Info, Mass_kg, CenterOfGravity, LoadCaseNames
analyze_karamba3d = AnalyzeKaramba3D(Model=assemble_model_karamba3d.Model)  # -> CalculatedModel, MaximumDisplacement_cm, ResultingForceOfGravity_kN, ElasticEnergyChange_kNm
model_view_karamba3d = ModelViewKaramba3D(Model=analyze_karamba3d.CalculatedModel, ResultFactors=1, ResultCase=-1)  # -> Model, DeformedMesh, DeformedAxes, DeformedModel
